# Requirement set throttleReqs (R2018a)

## 1 [controller_1] Must convert pedal signal into throttle control signal.
The controller must convert the pedal signal into a throttle control signal.

## 2 [throttleReqs] References to throttleReqs.doc
Read-only references to Microsoft Word document.

### 2.1 [Input Scaling]

#### 2.1.1 [inp_scl_1] Scaled data must be responsive t...
Scaled data must be responsive to full range of input data.

#### 2.1.2 [inp_scl_2] Output range for each signal must be normalized.

### 2.2 [PI Controller]

#### 2.2.1 [pi_ctrl_1] Must implement standard proporti...
Must implement standard proportional plus integral control algorithm.

#### 2.2.2 [pi_ctrl_2] Proportional and integral gains ...
Proportional and integral gains should be adjustable.

#### 2.2.3 [pi_ctrl_3] Measures must be taken to preven...
Measures must be taken to prevent windup in integral state.

### 2.3 [PWM Conversion]

#### 2.3.1 [pwm_1] Duty cycle must be proportional ...
Duty cycle must be proportional to controller output, when in a valid range.

#### 2.3.2 [pwm_2] PWM torque should act in positiv...
PWM torque should act in positive sense when controller output is positive or zero.

#### 2.3.3 [pwm_3] PWM torque should act in negativ...
PWM torque should act in negative sense when controller output is negative.

#### 2.3.4 [pwm_4] Duty cycle must be in range from 0 to 1.

### 2.4 [Output Scaling]

#### 2.4.1 [out_scl_1] Scaled data must be responsive t...
Scaled data must be responsive to full range of input data.

#### 2.4.2 [out_scl_2] Output data must be scaled for d...
Output data must be scaled for direct input to driver software.

## 3 [#18] Justifications (Justification)

### 3.1 [#19] Non-functional requirement (Justification)

### 3.2 [#20] Non-functional requirement (Justification)

### 3.3 [#21] Non-functional requirement (Justification)

### 3.4 [#22] Non-functional requirement (Justification)

### 3.5 [#23] Non-functional requirement (Justification)