% Requirement links of controller.slx (R2018a)

model links to throttleReqs.slreqx#1: controller_1: Must convert pedal signal into throttle control signal.
block :14 links to throttleReqs.doc#@out_scl_1: out_scl_1: Scaled data must be responsive t...
block :14 links to throttleReqs.doc#@out_scl_2: out_scl_2: Output data must be scaled for d...
block :3 links to throttleReqs.doc#@inp_scl_1: inp_scl_1: Scaled data must be responsive t...
block :3 links to throttleReqs.doc#@inp_scl_2: inp_scl_2: Output range for each signal must be normalized.