% Requirement links of piCtrl.slx (R2018a)

model links to throttleReqs.doc#@pi_ctrl_1: pi_ctrl_1: Must implement standard proporti...
model links to throttleReqs.doc#@pi_ctrl_2: pi_ctrl_2: Proportional and integral gains ...
model links to throttleReqs.doc#@pi_ctrl_3: pi_ctrl_3: Measures must be taken to preven...